# Grasshopper definition Secondary Truss Generator.gh (Grasshopper 1.0.8)

# ---- group: Truss Depth
eml_secondary_truss_depth = Slider(5, range=5..20)

# ---- group: Targeted Upper Element Length
# Secondary Trusses
eml_secondary_truss_targeted_upper_eleme = Slider(10.4, range=0..40)  # "eml_secondary_truss_targeted_upper_element_length"

# ----
# Secondary Truss Creation
eml_secondary_truss_output_lines = Curve()
len = Length(Curve=eml_secondary_truss_output_lines)
division = Division(A=len, B=eml_secondary_truss_targeted_upper_eleme)
Z = UnitZ(Factor=expr("-x", eml_secondary_truss_depth))
panel = Panel("""0
-1""")
int = Integer(division)
lng = ListLength(List=flatten(eml_secondary_truss_output_lines))
eval = Evaluate(E="Round(x/4)*4", x=int)

# ---- group: number of panels
int_2 = Integer(eval)

# ----
divide = DivideCurve(Curve=eml_secondary_truss_output_lines, Count=eval, Kinks=False)  # -> simplify(Points), Tangents, Parameters
move = Move(Geometry=divide.Points, Motion=Z)  # -> Geometry, Transform
item = ListItem(List=divide.Points, Index=0, Wrap=True)  # -> Item2, Item1, Item, Item1_2
cull_i = CullIndex(List=move.Geometry, Indices=panel, Wrap=True)  # -> simplify(List)
item_2 = ListItem(List=cull_i, Index=0, Wrap=True)  # -> Item1, Item
ln = Line(StartPoint=item.Item1, EndPoint=item_2.Item1)
ln_2 = Line(StartPoint=item.Item, EndPoint=item_2.Item)
relitem = RelativeItem(Tree=flatten(divide.Points), Offset="{0}[+1]", WrapPaths=False, WrapItems=False)  # -> ItemA, ItemB
relitem_2 = RelativeItem(Tree=flatten(cull_i), Offset="{0}[+1]", WrapPaths=False, WrapItems=False)  # -> ItemA, ItemB
project = ProjectPoint(Point=item.Item2, Direction=Vector(0, 0, -1), Geometry=ln)  # -> Point, Index
project_2 = ProjectPoint(Point=item.Item1_2, Direction=Vector(0, 0, -1), Geometry=ln_2)  # -> Point, Index
panel_2 = Panel("""0
-1""")
pt = Point(cull_i)
relitem_3 = RelativeItem(Tree=divide.Points, Offset="{0}[+1]", WrapPaths=False, WrapItems=False)  # -> ItemA, ItemB
relitem_4 = RelativeItem(Tree=cull_i, Offset="{0}[+1]", WrapPaths=False, WrapItems=False)  # -> ItemA, ItemB
equals = Equality(FirstNumber=lng, SecondNumber=1)  # -> Equality, Inequality
pt_2 = Point(divide.Points)
crv_cp = CurveClosestPoint(Point=project.Point, Curve=ln)  # -> Point, Parameter, Distance
crv_cp_2 = CurveClosestPoint(Point=project_2.Point, Curve=ln_2)  # -> Point, Parameter, Distance
ln_3 = Line(StartPoint=relitem_2.ItemA, EndPoint=relitem_2.ItemB)  # -> flatten(Line)
ln_4 = Line(StartPoint=relitem_4.ItemA, EndPoint=relitem_4.ItemB)  # -> flatten(Line)
ln_5 = Line(StartPoint=relitem.ItemA, EndPoint=relitem.ItemB)
ln_6 = Line(StartPoint=relitem_3.ItemA, EndPoint=relitem_3.ItemB)
cull_i_2 = CullIndex(List=pt_2, Indices=panel_2, Wrap=True)
relitem2 = RelativeItems(TreeA=simplify(flatten(cull_i_2)), TreeB=flatten(pt), Offset="{0}[+1]", WrapPaths=False, WrapItems=False)  # -> ItemA, ItemB
relitem2_2 = RelativeItems(TreeA=simplify(cull_i_2), TreeB=pt, Offset="{0}[+1]", WrapPaths=False, WrapItems=False)  # -> ItemA, ItemB
shatter = Shatter(Curve=ln, Parameters=crv_cp.Parameter)  # -> reverse(flatten(Segments))
shatter_2 = Shatter(Curve=ln_2, Parameters=crv_cp_2.Parameter)  # -> flatten(Segments)
ln_7 = Line(StartPoint=cull_i_2, EndPoint=pt)
ln_8 = Line(StartPoint=relitem2_2.ItemA, EndPoint=relitem2_2.ItemB)
ln_9 = Line(StartPoint=relitem2.ItemA, EndPoint=relitem2.ItemB)
filter = StreamFilter(Gate=equals.Equality, Stream0=ln_6, Stream1=ln_5)
filter_2 = StreamFilter(Gate=equals.Equality, Stream0=ln_4, Stream1=ln_3)
merge = Merge(Data1=shatter_2, Data2=filter_2, Data3=shatter)
filter_3 = StreamFilter(Gate=equals.Equality, Stream0=ln_8, Stream1=ln_9)
eml_secondary_truss_upper_cord_lines = Line(flatten(filter))
eml_secondary_truss_diagonal_lines = Line(flatten(filter_3))
eml_secondary_truss_bottom_cord_lines = Line(flatten(merge))
eml_secondary_truss_vertical_lines = Line(flatten(ln_7))
