# Grasshopper definition Stadium Roof Geometry.gh (Grasshopper 1.0.8)

# ---- group: Oval Example 1
# Roof Config
crv = Curve(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)

# ---- group: Number of Secondary Trusses
eml_number_of_secondary_trusses = Slider(10, range=5..15)

# ---- group: Proportion of Primary Trusses (0 to1)
eml_proportion_of_primary_trusses = Slider(0.53, range=0.4..0.8)

# ---- group: Number of Primary Trusses
eml_number_of_primary_trusses = Slider(11, range=5..15)

# ---- group: Oval Example 2
crv_2 = Curve(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)

# ---- group: Oval-shaped Input Curve
eml_oval_shaped_input_curve = Curve()

# ----
area = Area(Geometry=eml_oval_shaped_input_curve)  # -> Area, Centroid
rotate = Rotate(Geometry=eml_oval_shaped_input_curve, Angle=degrees(Slider(0, range=0..100)), Plane=area.Centroid)  # -> Geometry, Transform
ipy2 = IronPython2Script(crv=rotate.Geometry)  # -> out, R1, R2; inputs crv: Curve
# ---------- ipy2: IronPython ----------
import Rhino.Geometry as rg
import Rhino.Geometry.Intersect as ri

# Inputs (Grasshopper):
#   crv    : Closed curve (ellipse-like)
#   samples: int (optional)
# Outputs:
#   R1, R2 : Lines for longest/shortest radii, both pointing toward -Y
#   center : Point3d

if 'samples' not in globals() or samples is None:
    samples = 200

def sample_centroid_by_length(curve, n):
    n = max(4, int(n))
    t_params = curve.DivideByCount(n, True)  # equal arc-length partitions
    pts = [curve.PointAt(t) for t in t_params]
    cx = sum(p.X for p in pts) / len(pts)
    cy = sum(p.Y for p in pts) / len(pts)
    cz = sum(p.Z for p in pts) / len(pts)
    return rg.Point3d(cx, cy, cz), pts

def arg_max_min(pts, c):
    # using squared distance avoids sqrt and is equivalent for arg min/max
    d2 = [(p, c.DistanceToSquared(p)) for p in pts]
    pmax = max(d2, key=lambda x: x[1])[0]
    pmin = min(d2, key=lambda x: x[1])[0]
    return pmax, pmin

def oriented_hit_to_neg_y(center, pt_on_curve, curve, pick='farthest'):
    """
    Ensure the chosen endpoint lies in the -Y half-plane.
    If pt is already in -Y (pt.Y <= center.Y), keep it.
    Otherwise, shoot a ray from center in the opposite direction and intersect the curve.
      - For the 'longest' radius use the farthest hit along that ray.
      - For the 'shortest' radius use the nearest hit along that ray.
    """
    v = pt_on_curve - center
    if v.Y <= 0:  # already in -Y half-plane
        return pt_on_curve

    # Shoot a long line from center in -v direction
    v_u = rg.Vector3d(v)
    if not v_u.Unitize():
        return pt_on_curve
    bb = curve.GetBoundingBox(True)
    reach = max(1.0, bb.Diagonal.Length * 4.0)
    end = center - v_u * reach
    ln = rg.Line(center, end)

    tol = 1e-6
    x = ri.Intersection.CurveLine(curve, ln, tol, tol)
    if (x is None) or (x.Count == 0):
        # fallback: keep original
        return pt_on_curve

    # Collect intersections lying in -Y half-plane and in the -v direction
    candidates = []
    for i in range(x.Count):
        ev = x[i]
        if not ev.IsPoint:
            continue
        p = ev.PointA
        w = p - center
        # same half-plane and same direction along -v
        if (w.Y <= 0) and (w * (-v_u) > 0):
            candidates.append((p, w.Length))

    if not candidates:
        return pt_on_curve

    if pick == 'nearest':
        return min(candidates, key=lambda t: t[1])[0]
    else:
        return max(candidates, key=lambda t: t[1])[0]

# ---- Main ----
if crv and crv.IsClosed:
    C, pts = sample_centroid_by_length(crv, samples)
    pmax, pmin = arg_max_min(pts, C)

    # Force both radii to end in -Y half-plane
    pmax = oriented_hit_to_neg_y(C, pmax, crv, pick='farthest')  # longest
    pmin = oriented_hit_to_neg_y(C, pmin, crv, pick='nearest')   # shortest

    R1 = rg.Line(C, pmax)   # longest radius, pointing toward -Y
    R2 = rg.Line(C, pmin)   # shortest radius, pointing toward -Y
    center = C
else:
    R1 = R2 = center = None
# ---------- end ipy2 ----------
eval = EvaluateCurve(Curve=reparameterize(ipy2.R1), Parameter=eml_proportion_of_primary_trusses)  # -> Point, Tangent, Angle
vec = Vector(expr("-x", ipy2.R2))
vec_2 = Vector(expr("-x", ipy2.R1))
vec_3 = Vector(ipy2.R2)
vec_4 = Vector(ipy2.R1)
merge = Merge(Data1=vec_3, Data2=vec)
merge_2 = Merge(Data1=vec_4, Data2=vec_2)
project = ProjectPoint(Point=eval.Point, Direction=merge, Geometry=rotate.Geometry)  # -> Point, Index
item = ListItem(List=project.Point, Index=0, Wrap=True)  # -> Item, Item1
mirror = Mirror(Geometry=project.Point, Plane=ipy2.R1)  # -> Geometry, Transform
item_2 = ListItem(List=mirror.Geometry, Index=0, Wrap=True)  # -> Item, Item1
ln = Line(StartPoint=mirror.Geometry, EndPoint=project.Point)
ln_2 = Line(StartPoint=item_2.Item, EndPoint=item_2.Item1)
ln_3 = Line(StartPoint=item.Item, EndPoint=item.Item1)
merge_3 = Merge(Data1=project.Point, Data2=mirror.Geometry)
divide = DivideCurve(Curve=ln, Count=eml_number_of_primary_trusses, Kinks=False)  # -> Points, Tangents, Parameters
divide_2 = DivideCurve(Curve=[ln_3, ln_2], Count=eml_number_of_secondary_trusses, Kinks=False)  # -> Points, Tangents, Parameters
line = Line(ipy2.R1)
line_2 = Line(ipy2.R2)
crv_cp = CurveClosestPoint(Point=merge_3, Curve=rotate.Geometry)  # -> Point, Parameter, Distance
lng = ListLength(List=divide_2.Points)
lng_2 = ListLength(List=divide.Points)
shatter = Shatter(Curve=rotate.Geometry, Parameters=crv_cp.Parameter)
split = SplitList(List=divide_2.Points, Index=expr("x-1", lng))  # -> ListA, flatten(ListB)
split_2 = SplitList(List=divide.Points, Index=expr("x-1", lng_2))  # -> ListA, flatten(ListB)
bang = ExplodeTree(Data=divide.Points)  # -> Branch0, Branch1
item_3 = ListItem(List=shatter, Index=0, Wrap=True)  # -> Item, Item1, Item2, Item3
split_3 = SplitList(List=split.ListA, Index=1)  # -> flatten(ListA), simplify(ListB)
unit_z = UnitZ(Factor=1)
vector_2pt = Vector2Pt(PointA=bang.Branch0, PointB=bang.Branch1, Unitize=False)  # -> Vector, Length
split_4 = SplitList(List=split_2.ListA, Index=1)  # -> flatten(ListA), simplify(ListB)
merge_4 = Merge(Data1=item_3.Item, Data2=item_3.Item2)
merge_5 = Merge(Data1=item_3.Item3, Data2=item_3.Item1)
explode_tree = ExplodeTree(Data=split_3.ListB)  # -> _0000, Branch1
construct_plane = ConstructPlane(Origin=divide.Points, XAxis=vector_2pt.Vector, YAxis=unit_z)
vector_2pt_2 = Vector2Pt(PointA=explode_tree._0000, PointB=explode_tree.Branch1, Unitize=False)  # -> Vector, Length
pt = Point(split_3.ListB)
construct_plane_2 = ConstructPlane(Origin=pt, XAxis=vector_2pt_2.Vector, YAxis=unit_z)
curve_plane = CurvePlane(Curve=graft(merge_4), Plane=construct_plane)  # -> Points, ParamsC, ParamsP

# ---- group: Corners
pt_2 = Point([split_4.ListA, split_2.ListB])
pt_3 = Point([split_3.ListA, split.ListB])

# ----
graft_tree = GraftTree(Tree=pt, IncludeEmptyLists=True, IncludeNullItems=True)  # -> simplify(Tree)
curve_plane_2 = CurvePlane(Curve=graft(merge_5), Plane=construct_plane_2)  # -> Points, ParamsC, ParamsP
trim_tree = TrimTree(Tree=curve_plane.Points, Depth=1)
explode_tree_2 = ExplodeTree(Data=simplify(trim_tree))  # -> Branch0, Branch1
trim_tree_2 = TrimTree(Tree=curve_plane_2.Points, Depth=1)
flip_matrix = FlipMatrix(Data=trim_tree_2)
ln_4 = Line(StartPoint=explode_tree_2.Branch1, EndPoint=explode_tree_2.Branch0)
entwine = Entwine(Branch0X=flip_matrix, Branch1X=flip_matrix, FlattenInputs=False)  # -> simplify(Result)
closest_point = ClosestPoint(Point=graft(graft_tree), Cloud=entwine)  # -> ClosestPoint, CPIndex, Distance
ln_5 = Line(StartPoint=graft_tree, EndPoint=closest_point.ClosestPoint)  # -> flatten(Line)
ln_6 = Line(StartPoint=bang.Branch0, EndPoint=bang.Branch1)  # disabled
eml_secondary_truss_output_lines = Line(ln_5)
eml_primary_truss_output_lines = Line(ln_4)
